# Grasshopper definition Flute Design.gh (Grasshopper 1.0.8)
# plug-ins: Pufferfish

mouth_height = Panel("0.5")
mouth_width_adjustment = Slider(0.7308, range=0..2)
distance_to_mouth = Panel("3")
bottom_connector_depth = Panel("0.75")
diameter_at_mouth = Panel("6")
thickness = Panel("3/32")
exterior_diameter_bottom = Panel("2.75")
languid_shift = Slider(-0.58, range=-2..2)
mouth_angle = Slider(0, range=0..45)
languid_angle = Slider(5, range=0..45)
distance_to_rim_bottom = Panel("1.5")
exterior_diameter_top = Panel("2.75")
distance_to_rim_top = Panel("0.2")
distance_to_top_connector = Panel("0")
top_connector_depth = Panel("0.75")
languid_thickness = Panel("-0.2")
xy_plane = XYPlane(Origin=Point(0, 0, 0))
unit_z = UnitZ(Factor=bottom_connector_depth)
multiplication = Multiplication(A=thickness, B=2)
move = Move(Geometry=xy_plane, Motion=unit_z)  # -> Geometry, Transform
unit_z_2 = UnitZ(Factor=distance_to_mouth)
circle = Circle(Plane=xy_plane, Radius=expr("x/2", exterior_diameter_bottom))
unit_z_3 = UnitZ(Factor=mouth_height)
move_2 = Move(Geometry=move.Geometry, Motion=unit_z_2)  # -> Geometry, Transform
unit_z_4 = UnitZ(Factor=distance_to_rim_bottom)
unit_z_5 = UnitZ(Factor=distance_to_rim_top)
circle_2 = Circle(Plane=move.Geometry, Radius=expr("x/2", exterior_diameter_bottom))
unit_z_6 = UnitZ(Factor=distance_to_top_connector)
unit_z_7 = UnitZ(Factor=top_connector_depth)
move_3 = Move(Geometry=move_2.Geometry, Motion=unit_z_3)  # -> Geometry, Transform
circle_3 = Circle(Plane=move_2.Geometry, Radius=expr("x/2", diameter_at_mouth))
move_4 = Move(Geometry=move_3.Geometry, Motion=unit_z_4)  # -> Geometry, Transform
move_5 = Move(Geometry=move_4.Geometry, Motion=unit_z_5)  # -> Geometry, Transform
move_6 = Move(Geometry=move_5.Geometry, Motion=unit_z_6)  # -> Geometry, Transform
circle_4 = Circle(Plane=move_3.Geometry, Radius=expr("x/2", diameter_at_mouth))
move_7 = Move(Geometry=move_6.Geometry, Motion=unit_z_7)  # -> Geometry, Transform
circle_5 = Circle(Plane=move_4.Geometry, Radius=expr("x/2", exterior_diameter_top))
circle_6 = Circle(Plane=move_5.Geometry, Radius=expr("x/2", exterior_diameter_top))
circle_7 = Circle(Plane=move_4.Geometry, Radius=expr("x/2", exterior_diameter_top))
circle_8 = Circle(Plane=move_7.Geometry, Radius=expr("x/2", exterior_diameter_top))
division = Division(A=exterior_diameter_bottom, B=mouth_width_adjustment)
division_2 = Division(A=division, B=2)
merge = Merge(Data1=circle, Data2=circle_2, Data3=circle_3, Data4=circle_4, Data5=circle_7, Data6=circle_8)
construct_domain = ConstructDomain(DomainStart=expr("x*-1", division_2), DomainEnd=division_2)
loft = Loft(
    Curves=[circle_5, circle_6],
    Options={Adjust=False, Closed=False, LoftEnds=0, LoftSimp=0, LoftType=0, Rebuild=10, Refit=0.01})
loft_2 = Loft(Curves=merge, Options={Adjust=False, Closed=False, LoftEnds=0, LoftSimp=0, LoftType=3, Rebuild=10, Refit=0.01})
unit_z_8 = UnitZ(Factor=mouth_height)
rectangle = Rectangle(Plane=move_2.Geometry, XSize="100", YSize=construct_domain, Radius=0)  # -> Rectangle, Length
xz_plane = XZPlane(Origin=move_2.Geometry)
cap_holes = CapHoles(Brep=loft_2)
deconstruct_brep = DeconstructBrep(Brep=cap_holes)  # -> Faces, Edges, Vertices
merge_2 = Merge(Data1="5", Data2="6")
xz_plane_2 = XZPlane(Origin=move_2.Geometry)
rotate = Rotate(Geometry=rectangle.Rectangle, Angle=degrees(mouth_angle), Plane=xz_plane)  # -> Geometry, Transform
list_item = ListItem(List=deconstruct_brep.Faces, Index=Slider(5, range=0..100), Wrap=True)
rotate_2 = Rotate(Geometry=circle_3, Angle=degrees(languid_angle), Plane=xz_plane_2)  # -> Geometry, Transform
rotate_3 = Rotate(Geometry=xz_plane_2, Angle=degrees(languid_angle), Plane=xz_plane_2)  # -> Geometry, Transform
shell_polysurface = ShellPolysurface(Polysurface=cap_holes, Removal=merge_2, Thickness=thickness, FaceMerge=False)
extrude = Extrude(Base=rotate.Geometry, Direction=unit_z_8)
deconstruct_plane = DeconstructPlane(Plane=rotate_3.Geometry)  # -> Origin, XAxis, YAxis, ZAxis
cap_holes_2 = CapHoles(Brep=extrude)
solid_difference = SolidDifference(BrepsA=shell_polysurface, BrepsB=cap_holes_2)
amplitude = Amplitude(Vector=deconstruct_plane.XAxis, Amplitude=languid_shift)
move_8 = Move(Geometry=rotate_2.Geometry, Motion=amplitude)  # -> Geometry, Transform
amplitude_2 = Amplitude(Vector=deconstruct_plane.YAxis, Amplitude=languid_thickness)
extrude_2 = Extrude(Base=move_8.Geometry, Direction=amplitude_2)
cap_holes_3 = CapHoles(Brep=extrude_2)
solid_intersection = SolidIntersection(BrepsA=cap_holes_3, BrepsB=cap_holes)
solid_union = SolidUnion(Breps=flatten([solid_difference, solid_intersection]))
